# Dynamo graph Civil3D_LayersToModel.dyn (Dynamo 2.5.2.7915)
# packages: Civil3DToolkit 1.1.30

file_path = Filename("D:\COBA\CODING\layerOptimizationModel\layerSolutions_left_Civil.xlsx")
file_from_path = FileObject(path=file_path)
code_block = CodeBlock { "left"; false; true; }
importExcel = Data.ImportExcel(file=file_from_path, sheetName=code_block.out0, readAsStrings=code_block.out1, showExcel=code_block.out2)
code_block_2 = CodeBlock { 0; }
removeItemAtIndex = List.RemoveItemAtIndex(list=importExcel, indices=code_block_2)
count = List.Count(list=removeItemAtIndex)
transpose = List.Transpose(lists=removeItemAtIndex)
KMS = CodeBlock(a=transpose) { a[0]; }
code_block_3 = CodeBlock { 0; }
removeItemAtIndex_2 = List.RemoveItemAtIndex(list=transpose, indices=code_block_3)
transpose_2 = List.Transpose(lists=removeItemAtIndex_2)
python_script = Python(IN[0]=transpose_2)
# ---------- python_script.python (64 lines) ----------
__author__ = 'Goncalo Bastos - bastos.g.goncalo@gmail.com'
__copyright__ = '2022'
__version__ = '1.0.0'

##############################################################

# Load the Python Standard and DesignScript Libraries
import sys
import clr

# Add Assemblies for AutoCAD and Civil3D
clr.AddReference('AcMgd')
clr.AddReference('AcCoreMgd')
clr.AddReference('AcDbMgd')
clr.AddReference('AecBaseMgd')
clr.AddReference('AecPropDataMgd')
clr.AddReference('AeccDbMgd')
clr.AddReference('ProtoGeometry')
clr.AddReference('AutoCADNodes')
clr.AddReference('Civil3DNodes')   
clr.AddReference('Autodesk.Civil3DToolkit')
clr.AddReference('DSCoreNodes')

# Import references from AutoCAD
from Autodesk.AutoCAD.Runtime import *
from Autodesk.AutoCAD.ApplicationServices import *
from Autodesk.AutoCAD.EditorInput import *
from Autodesk.AutoCAD.DatabaseServices import *
from Autodesk.AutoCAD.Geometry import *

# Import references from Civil3D
from Autodesk.Civil.ApplicationServices import *
from Autodesk.Civil.DatabaseServices import *

# Import references from Dynamo
import Autodesk.AutoCAD.DynamoNodes as DA
import Autodesk.Civil.DynamoNodes as DC
import Autodesk.DesignScript.Geometry as DS
import DSCore
from Autodesk.AutoCAD.DynamoNodes import *
from Autodesk.Civil.DynamoNodes import *
#from Autodesk.DesignScript.Geometry import *
from DSCore import *


##############################################################

INPUTS = IN


"""
adoc = Application.DocumentManager.MdiActiveDocument
editor = adoc.Editor
db = adoc.Database

with adoc.LockDocument():
    with db:
        with db.TransactionManager.StartTransaction() as t:

            #t.Commit()
            pass
"""

OUT = 0
# ----------------------------------------
select_object = ObjectSelection()  # 1 picked in the model
code_block_4 = CodeBlock { 5; }
current = Autodesk.AutoCAD.DynamoNodes.Document.Current()
modelSpace = Autodesk.AutoCAD.DynamoNodes.Document.ModelSpace(document=current)
offset = Autodesk.AutoCAD.DynamoNodes.PolylineExtensions.Offset(polyline=select_object, offset=code_block_4, block=modelSpace)
byCornerPoints = Rectangle.ByCornerPoints()  # unwired: points
code_block_5 = CodeBlock { 0; 10; }
byCoordinates = Point.ByCoordinates(x=code_block_5.out0, y=code_block_5.out0)
byCoordinates_2 = Point.ByCoordinates(x=code_block_5.out0, y=code_block_5.out1)
byCoordinates_3 = Point.ByCoordinates(x=code_block_5.out1, y=code_block_5.out1)
byCoordinates_4 = Point.ByCoordinates(x=code_block_5.out1, y=code_block_5.out0)
byCornerPoints_2 = Rectangle.ByCornerPoints(p1=byCoordinates, p2=byCoordinates_2, p3=byCoordinates_3, p4=byCoordinates_4)
