# Dynamo graph Civil3D_LayersToSectionView.dyn (Dynamo 2.5.2.7915)
# packages: Civil3DToolkit 1.1.30, Camber 1.0.1

current = Autodesk.AutoCAD.DynamoNodes.Document.Current()
modelSpace = Autodesk.AutoCAD.DynamoNodes.Document.ModelSpace(document=current)
getSectionViews = Autodesk.Civil.DynamoNodes.SectionView.GetSectionViews(block=modelSpace)
getFromCivilObject = Camber.Civil.SectionView.GetFromCivilObject(civilObject=getSectionViews)
code_block = CodeBlock { 0; 1; }
getPointAtOffsetElevation = Camber.Civil.SectionView.GetPointAtOffsetElevation(sectionView=getFromCivilObject, offset=code_block.out0)  # unwired: elevation
byCenterPointRadius = Circle.ByCenterPointRadius(centerPoint=getPointAtOffsetElevation, radius=code_block.out1)
code_block_2 = CodeBlock { "@AUX"; }
byGeometry = Autodesk.AutoCAD.DynamoNodes.Object.ByGeometry(geometry=byCenterPointRadius, layer=code_block_2, block=modelSpace)
